# Dynamo graph ManageDocuments.dyn (Dynamo 2.9.0.2476)

file_path = Filename("E:\Nextcloud\BIM-CAFM-CAD\freecad\Part Test_2.FCStd")
directory_path = Directory("E:\_PortableApps\FreeCAD\FreeCAD-conda-PY3.8-site_packages1\bin")
openDocument = Custom[OpenDocument](filePath=file_path, FreeCADBinPath=directory_path)  # Open a document in FreeCAD
newDocument = Custom[NewDocument](FreeCADBinPath=directory_path)  # Create new document in FreeCAD
name = Custom[Name](FreeCADDocument=newDocument.FreeCADDocument)  # Returns the name of a FreeCAD document
boolean = BoolSelector(true)
activeDocument = Custom[ActiveDocument](reload=boolean)  # Get active FreeCAD document
fileName = Custom[FileName](FreeCADDocument=activeDocument)  # Full path including filename of a FreeCAD document
saveAs = Custom[SaveAs](path=fileName, FreeCADDocument=activeDocument)  # Save FreeCAD document to a path
listDocuments = Custom[ListDocuments](reload=boolean)  # List all open FreeCAD documents
keys = DesignScript.Builtin.Dictionary.Keys(dictionary=listDocuments)
code_block = CodeBlock { 1; }
getItemAtIndex = List.GetItemAtIndex(list=keys, index=code_block)
valueAtKey = DesignScript.Builtin.Dictionary.ValueAtKey(dictionary=listDocuments, key=getItemAtIndex)
setActiveDocument = Custom[SetActiveDocument](FreeCADDocument=valueAtKey)  # Set active FreeCAD document
boolean_2 = BoolSelector(true)
closeAllDocuments = Custom[CloseAllDocuments](run=boolean_2)  # Close all open FreeCAD documents
closeDocument = Custom[CloseDocument](FreeCADDocument=valueAtKey)  # Close an open FreeCAD document
