# Dynamo custom node OpenDocument.dyf (Dynamo 2.8.0.2327)
# category: DynFreeCAD.Document
# Open a document in FreeCAD

Path = Input(Path: string)
python_script = Python(IN[0]=Path)  # CPython3
# ---------- python_script.python (7 lines) ----------
import FreeCAD

docPath = IN[0]

ad = FreeCAD.openDocument(docPath)

OUT = ad
# ----------------------------------------
FreeCADDocument = Output(python_script)
